# Grasshopper definition FlexTure.gh (Grasshopper 1.0.7)
# plug-ins: Human UI, GraphicPlus

num = Number(0.1)

u_gap_size = Slider(0, range=0..20)
v_gap_size = Slider(0, range=0..20)
cell_center_thickness = Slider(5, range=0..20)
cell_leg_width = Slider(3, range=0..20)
cell_length = Slider(10, range=0..20)
cell_width = Slider(6, range=0..20)
gap_width = Slider(1, range=0..20)
panel = Panel("""Rectangular
Triangular""")
slider = CreateSlider(
    Slider=u_gap_size,
    SnapValue=num,
    ShowBounds=False,
    ShowTicks=False,
    ShowTooltip=False,
    ShowValLabel=True,
    showLabel=True)
slider_2 = CreateSlider(
    Slider=v_gap_size,
    SnapValue=num,
    ShowBounds=False,
    ShowTicks=False,
    ShowTooltip=False,
    ShowValLabel=True,
    showLabel=True)
pickbtn = CreateRhinoPickButton(
    ButtonName="Select domain",
    Prompt="Please select geometry...",
    AllowMultiple=False,
    AllowNone=True,
    Type=1,
    ButtonStyle=0)
listbox = CreateListBox(ListItems=panel, SelectedIndex=0, Height=50)
slider_3 = CreateSlider(
    Slider=cell_length,
    SnapValue=num,
    ShowBounds=False,
    ShowTicks=False,
    ShowTooltip=False,
    ShowValLabel=True,
    showLabel=True)
slider_4 = CreateSlider(
    Slider=cell_center_thickness,
    SnapValue=num,
    ShowBounds=False,
    ShowTicks=False,
    ShowTooltip=False,
    ShowValLabel=True,
    showLabel=True)
slider_5 = CreateSlider(
    Slider=cell_leg_width,
    SnapValue=num,
    ShowBounds=False,
    ShowTicks=False,
    ShowTooltip=False,
    ShowValLabel=True,
    showLabel=True)
slider_6 = CreateSlider(
    Slider=cell_width,
    SnapValue=num,
    ShowBounds=False,
    ShowTicks=False,
    ShowTooltip=False,
    ShowValLabel=True,
    showLabel=True)
slider_7 = CreateSlider(Slider=gap_width, SnapValue=num, ShowBounds=False, ShowTicks=False, ShowTooltip=False, ShowValLabel=True, showLabel=True)
label = CreateLabel(LabelText="Rectangular pattern only", LabelSize=12, Justification=0)
label_2 = CreateLabel(LabelText="Triangular pattern only", LabelSize=12, Justification=0)
values = ValueListener(Elements=slider, SomeProperty=True)  # -> Values, Indices
values_2 = ValueListener(Elements=slider_2, SomeProperty=True)  # -> Values, Indices
values_3 = ValueListener(Elements=slider_3, SomeProperty=True)  # -> Values, Indices
values_4 = ValueListener(Elements=slider_4, SomeProperty=True)  # -> Values, Indices
values_5 = ValueListener(Elements=slider_5, SomeProperty=True)  # -> Values, Indices
values_6 = ValueListener(Elements=slider_7, SomeProperty=True)  # -> Values, Indices
values_7 = ValueListener(Elements=slider_6, SomeProperty=True)  # -> Values, Indices
cell_length_2 = Number(values_3.Values)
cell_central_thickness = Number(values_4.Values)
cell_leg_width_2 = Number(values_5.Values)
gap_v = Number(values_2.Values)
gap_u = Number(values.Values)
gap_width_2 = Number(values_6.Values)
cell_width_2 = Number(values_7.Values)
merge = Merge(
    Data1=pickbtn,
    Data2=listbox,
    Data3=slider,
    Data4=slider_2,
    Data5=slider_3,
    Data6=label,
    Data7=slider_4,
    Data8=slider_5,
    Data9=label_2,
    Data10=slider_6,
    Data11=slider_7)
expander = CreateExpander(UIElements=merge, Header="Geometry & pattern", Open=True)

fillet_amplitude = Slider(3, range=0..3)
panel_2 = Panel("""None
Uniform
Gradient along U
Gradient along V
Grayscale Image""")
toggle = CreateToggle(Default=False, Invert="Invert")
filepicker = CreateFilePicker(ButtonLabelText="Browse...", DialogType=0, MustExist=True, Filter="All Files|*.*")
listbox_2 = CreateListBox(ListItems=panel_2, SelectedIndex=0, Height=125)
slider_8 = CreateSlider(
    Slider=fillet_amplitude,
    SnapValue=num,
    ShowBounds=False,
    ShowTicks=False,
    ShowTooltip=False,
    ShowValLabel=True,
    showLabel=True)
merge_2 = Merge(Data1=listbox_2, Data2=filepicker, Data3=slider_8, Data4=toggle)
expander_2 = CreateExpander(UIElements=merge_2, Header="Fillet", Open=True)
values_8 = ValueListener(Elements=filepicker, SomeProperty=True)  # -> Values, Indices
values_9 = ValueListener(Elements=slider_8, SomeProperty=True)  # -> Values, Indices
values_10 = ValueListener(Elements=toggle, SomeProperty=True)  # -> Values, Indices
fillet_rad = Number(values_9.Values)
bool = Boolean(values_10.Values)
path = FilePath(values_8.Values)

filepicker_2 = CreateFilePicker(ButtonLabelText="Browse...", DialogType=2, MustExist=False, Filter="SVG|*.svg*")
button = CreateButton(ButtonName="Click to save!", ButtonStyle=0)
merge_3 = Merge(Data1=filepicker_2, Data2=button)
values_11 = ValueListener(Elements=filepicker_2, SomeProperty=True)  # -> Values, Indices
values_12 = ValueListener(Elements=button, SomeProperty=True)  # -> Values, Indices
expander_3 = CreateExpander(UIElements=merge_3, Header="Export", Open=True)
save_path = FilePath(values_11.Values)
save = Boolean(values_12.Values)

values_13 = ValueListener(Elements=pickbtn, SomeProperty=True)  # -> Values, Indices
srf = Surface(values_13.Values)
evalsrf = EvaluateSurface(Surface=reparameterize(srf), Point=Point(0, 0, 0))  # -> Point, Normal, UDirection, VDirection, Frame

merge_4 = Merge(Data1=expander, Data2=expander_2, Data3=expander_3)
launchwin = LaunchWindow(Show=Toggle(True), Name="Control Window", Width=370, Height=400, ChildStatus=0, EnableHorizScroll=False)
addelems = AddElements(Window=launchwin, Elements=flatten(merge_4), DoVLChecking=True)  # -> AddedElements, ElementNames

multiplication = Multiplication(A=cell_leg_width_2, B=2)
addition = Addition(A=multiplication, B=cell_central_thickness)
addition_2 = Addition(A=cell_length_2, B=gap_u)
addition_3 = Addition(A=gap_v, B=addition)
rec_pattern = GhPythonScript(
    length=cell_length_2,
    centralThickness=cell_central_thickness,
    legWidth=cell_leg_width_2,
    base=evalsrf.Point,
    Uvec=evalsrf.UDirection,
    Vvec=evalsrf.VDirection)  # -> out, sampPt, pls
# ---------- rec_pattern: Python ----------
__author__ = "MML"
__version__ = "2023.01.29"

import rhinoscriptsyntax as rs

width = centralThickness + legWidth * 2
cVec = rs.VectorScale(Uvec, length * .5) + rs.VectorScale(Vvec, width * .5)
center = rs.VectorAdd(base, cVec)

p0v = rs.VectorScale(Vvec, width)
p1v = rs.VectorScale(Uvec, length) + rs.VectorScale(Vvec, width)
p2v = rs.VectorScale(Uvec, length) + rs.VectorScale(Vvec, legWidth)
p3v = rs.VectorScale(Uvec, legWidth) + rs.VectorScale(Vvec, legWidth)

vecs = [p0v, p1v, p2v, p3v]
pts = [rs.PointAdd(base, vec) for vec in vecs]

pl1 = rs.AddPolyline(pts)
pl2 = rs.RotateObject(pl1, center, 180, copy=True)
pls = [pl1, pl2]
sampPt = pts[1:3] + rs.RotateObjects(pts[1:3], center, 180, copy=True)

pl1Cen = rs.VectorDivide(rs.VectorAdd(pts[1], pts[2]), 2)
pl1Cen = rs.AddPoint(pl1Cen)
sampPt = [pl1Cen] + rs.RotateObjects([pl1Cen], center, 180, copy=True)
# ---------- end rec_pattern ----------
dom = ConstructDomain(DomainStart=0, DomainEnd=addition_2)
dom_2 = ConstructDomain(DomainStart=0, DomainEnd=addition_3)
rectangle = Rectangle(Plane=evalsrf.Frame, XSize=dom, YSize=dom_2, Radius=0)  # -> Rectangle, Length
pt = Point(rec_pattern.sampPt)
crv = Curve(rec_pattern.pls)
rec = Rectangle(rectangle.Rectangle)

addition_4 = Addition(A=cell_length_2, B=gap_u)
addition_5 = Addition(A=cell_width_2, B=gap_v)
dom_3 = ConstructDomain(DomainStart=0, DomainEnd=addition_4)
dom_4 = ConstructDomain(DomainStart=0, DomainEnd=addition_5)
tri_pattern = GhPythonScript(
    length=cell_length_2,
    width=cell_width_2,
    gap=gap_width_2,
    base=evalsrf.Point,
    Uvec=evalsrf.UDirection,
    Vvec=evalsrf.VDirection)  # -> out, sampPt, pls
# ---------- tri_pattern: Python ----------
__author__ = "MML"
__version__ = "2023.01.29"

import rhinoscriptsyntax as rs
import math as m

cVec = rs.VectorScale(Uvec, length * .5) + rs.VectorScale(Vvec, width * .5)
center = rs.VectorAdd(base, cVec)

p0v = rs.VectorScale(Uvec, length * .5) + rs.VectorScale(Vvec, width)
p1v = rs.VectorScale(Uvec, length *  1) + rs.VectorScale(Vvec, width * 0.75)
p2v = rs.VectorScale(Uvec, length * .5) + rs.VectorScale(Vvec, width * 0.5)

vecs = [p0v, p1v, p2v]
pts = [rs.PointAdd(base, vec) for vec in vecs]

pl1 = rs.AddPolyline(pts)
pivotAngle = m.atan((width / 4) / (length / 2))
cutLen = (gap / 2) / m.cos(pivotAngle)
pl1 = rs.ExtendCurveLength(pl1, 0, 2, -cutLen)

pl2 = rs.RotateObject(pl1, center, 180, copy=True)
pls = [pl1, pl2]
sampPt = [pts[1]] + rs.RotateObjects([pts[1]], center, 180, copy=True)
# ---------- end tri_pattern ----------
rectangle_2 = Rectangle(Plane=evalsrf.Frame, XSize=dom_3, YSize=dom_4, Radius=0)  # -> Rectangle, Length
pt_2 = Point(tri_pattern.sampPt)
crv_2 = Curve(tri_pattern.pls)
rec_2 = Rectangle(rectangle_2.Rectangle)

values_14 = ValueListener(Elements=listbox, SomeProperty=True)  # -> Values, Indices
filter = StreamFilter(Gate=values_14.Indices, Stream0=pt, Stream1=pt_2)
filter_2 = StreamFilter(Gate=values_14.Indices, Stream0=crv, Stream1=crv_2)
filter_3 = StreamFilter(Gate=values_14.Indices, Stream0=rec, Stream1=rec_2)
drec = DeconstuctRectangle(Rectangle=filter_3)  # -> BasePlane, XInterval, YInterval
dedomain = DeconstructDomain(Domain=drec.XInterval)  # -> Start, End
dedomain_2 = DeconstructDomain(Domain=drec.YInterval)  # -> Start, End
dim = Dimensions(Surface=srf)  # -> UDimension, VDimension
subtraction = Subtraction(A=dedomain.End, B=dedomain.Start)
subtraction_2 = Subtraction(A=dedomain_2.End, B=dedomain_2.Start)
division = Division(A=dim.UDimension, B=subtraction)
division_2 = Division(A=dim.VDimension, B=subtraction_2)
round = Round(Number=division)  # -> Nearest, Floor, Ceiling
round_2 = Round(Number=division_2)  # -> Nearest, Floor, Ceiling
arrrec = RectangularArray(Geometry=filter, Cell=filter_3, XCount=round.Floor, YCount=round_2.Floor)  # -> Geometry, Transform
arrrec_2 = RectangularArray(Geometry=filter_2, Cell=filter_3, XCount=round.Floor, YCount=round_2.Floor)  # -> Geometry, Transform
srf_cp = SurfaceClosestPoint(Point=arrrec.Geometry, Surface=reparameterize(srf))  # -> Point, UVPoint, Distance
img = ImportImage(File=path, Rectangle=srf)
pdecon = Deconstruct(Point=srf_cp.UVPoint)  # -> XComponent, YComponent, ZComponent
meshcp = MeshClosestPoint(Point=arrrec.Geometry, Mesh=img)  # -> Point, Index, Parameter
meval = MeshEval(Mesh=img, Parameter=meshcp.Parameter)  # -> Point, Normal, Colour
values_15 = ValueListener(Elements=listbox_2, SomeProperty=True)  # -> Values, Indices
int = Integer(0)
int_2 = Integer(1)
ahsv = SplitAHSV(Colour=meval.Colour)  # -> Alpha, Hue, Saturation, Value
filter_4 = StreamFilter(
    Gate=values_15.Indices,
    Stream0=int,
    Stream1=int_2,
    Stream2=pdecon.XComponent,
    Stream3=pdecon.YComponent,
    Stream4=ahsv.Value)
python = GhPythonScript(val=filter_4, amp=fillet_rad, invert=bool)  # -> out, r
# ---------- python: Python ----------
__author__ = "MML"
__version__ = "2023.01.29"

import rhinoscriptsyntax as rs

if(invert):
    val = 1 - val

r = val * amp
# ---------- end python ----------
fillet = Fillet(Curve=arrrec_2.Geometry, Radius=python.r)
wires = BrepWireframe(Brep=srf, Density=-1)
python_2 = GhPythonScript(curves=fillet, rad=fillet_rad, mode=values_14.Indices)  # -> out, curves
# ---------- python_2: Python ----------
__author__ = "MML"
__version__ = "2023.01.29"

import rhinoscriptsyntax as rs

if(mode == 0):
    curves = rs.ExtendCurveLength(curves, 0, 0, -rad)
# ---------- end python_2 ----------
join = JoinCurves(Curves=wires, Preserve=False)
merge_5 = Merge(Data1=flatten(python_2.curves), Data2=join)  # -> flatten(Result)
crv_3 = Curve(merge_5)
file_name = GhPythonScript(flag=save)  # -> out, t
# ---------- file_name: Python ----------
__author__ = "MML"
__version__ = "2023.01.29"

import rhinoscriptsyntax as rs
import time

t = []
if(flag):
    t = time.asctime()
    t = "pattern_" + t.replace(' ', '_').replace(':', '_')
# ---------- end file_name ----------
savesvg = SaveSvg(DrawingsShapesGeometry=crv_3, FolderPath=save_path, FileName=file_name.t, Save=save)
